# Grasshopper definition gears.gh (Grasshopper 1.0.7)

teeth_number = Slider(21, range=1..101)
rotation = Slider(155, range=0..360)
teeth_number_2 = GetInteger(teeth_number, AtLeast=1, AtMost=1, Maximum=2147483647, Minimum=-2147483648)
rotation_2 = GetInteger(rotation, AtLeast=1, AtMost=1, Maximum=2147483647, Minimum=-2147483648)

pt = ConstructPoint(XCoordinate=0, YCoordinate=0, ZCoordinate=0)
pt_2 = ConstructPoint(XCoordinate=0, YCoordinate=0, ZCoordinate=0)
addition = Addition(A="20", B=Slider(2, range=0..10))
multiplication = Multiplication(A=teeth_number_2, B="2")
cir = Circle(Plane=pt, Radius=addition)
cir_2 = Circle(Plane=pt_2, Radius="20")
panel = Panel("20")
multiplication_2 = Multiplication(A=addition, B="2")
offset = OffsetCurve(Curve=cir, Distance=expr("-x", 10), Corners=1)
subtraction = Subtraction(A=multiplication_2, B="1")
divide = DivideCurve(Curve=cir_2, Count=multiplication, Kinks=False)  # -> Points, Tangents, Parameters
divide_2 = DivideCurve(Curve=cir, Count=teeth_number_2, Kinks=False)  # -> Points, Tangents, Parameters
panel_2 = Panel("""0
1""")
cull = CullPattern(List=divide.Points, CullPattern=panel_2)
weave = Weave(Pattern=[0, 1], Stream0=divide_2.Points, Stream1=cull, NullGaps=False)
pline = PolyLine(Vertices=weave, Closed=invert(False))
smooth = SmoothNumbers(Numbers=rotation_2, SmoothDelay=2000)
X = UnitX(Factor=subtraction)
move = Move(Geometry=pline, Motion=X)  # -> Geometry, Transform
neg = Negative(Value=smooth)
area = Area(Geometry=move.Geometry)  # -> Area, Centroid
line = LineSDL(Start=area.Centroid, Direction=Vector(0, 0, 1), Length=1)
area_2 = Area(Geometry=pline)  # -> Area, Centroid
line_2 = LineSDL(Start=area_2.Centroid, Direction=Vector(0, 0, 1), Length=1)
number_slider = Slider(0.4, range=0..1)
rot3d = Rotate3D(Geometry=move.Geometry, Angle=degrees(smooth), Center=area.Centroid, Axis=line)  # -> Geometry, Transform
rot3d_2 = Rotate3D(Geometry=pline, Angle=degrees(neg), Center=area_2.Centroid, Axis=line_2)  # -> Geometry, Transform

move_2 = Move(Geometry=offset, Motion=X)  # -> Geometry, Transform
fillet = Fillet(Curve=rot3d.Geometry, Radius=number_slider)
boundary = BoundarySurfaces(Edges=[move_2.Geometry, fillet])
Z = UnitZ(Factor=Slider(5, range=0..100))
move_3 = Move(Geometry=boundary, Motion=Z)  # -> Geometry, Transform
extr = Extrude(Base=[move_2.Geometry, fillet], Direction=Z)
join = BrepJoin(Breps=[extr, move_3.Geometry, boundary])  # -> Breps, Closed

fillet_2 = Fillet(Curve=rot3d_2.Geometry, Radius=number_slider)
Z_2 = UnitZ(Factor=Slider(7, range=0..100))
crv = Curve(offset)
boundary_2 = BoundarySurfaces(Edges=[crv, fillet_2])
extr_2 = Extrude(Base=[crv, fillet_2], Direction=Z_2)
move_4 = Move(Geometry=boundary_2, Motion=Z_2)  # -> Geometry, Transform
join_2 = BrepJoin(Breps=[boundary_2, extr_2, move_4.Geometry])  # -> Breps, Closed

wires = BrepWireframe(Brep=[join_2.Breps, join.Breps], Density=-1)
mesh = MeshBrep(
    Brep=[join.Breps, join_2.Breps],
    Settings={GridMaxCount=0, GridMinCount=16, JaggedSeams=False, MaxEdgeLength=0, MinEdgeLength=0.0001, MinTolerance=0, Refine=True, RefineAngle=0, RelativeTolerance=0.65, SimplePlanes=True, Tolerance=0})
mcol = MeshColours(Mesh=mesh, Colours=ColourSwatch(SwatchColor=RGB(110, 110, 110)))

# ---- group: RH_OUT:mesh
mesh_2 = Mesh(flatten(mcol))
